% Simulink data dictionary SWC_AFE_Control.sldd
% references Shared.sldd

V2X = 2
FAULT_PRESENT = true
ACTIVE = true
INACTIVE = false
InpMgmt_ChrgrCurr_Inst_C = Simulink.Parameter(102, StorageClass="Volatile", DataType="single")  % DAB Output Current Instantaneous Max value
Unbalance_PhaseCurrent_Thd = Simulink.Parameter(3.3254, StorageClass="Volatile", DataType="single")  % DAB Primary side Inductor Current Unabalanced Threshold value (48*12/100)
InMgmtRequestedDCVRef_UThd = Simulink.Parameter(720, StorageClass="Volatile", DataType="single")  % DAB Primary Side Sic Max Temp Limit
InMgmtGridVRYBRMS_UThd = Simulink.Parameter(270, StorageClass="Volatile", DataType="single")  % DAB Primary Side Sic Max Temp Limit
InMgmtGridVRYBRMS_LThd = Simulink.Parameter(200, StorageClass="Volatile", DataType="single")  % DAB Primary Side Sic Max Temp Limit
GridFreq_UThd = Simulink.Parameter(53, StorageClass="Volatile", DataType="single")  % DAB Primary Side Sic Max Temp Limit
GridFreq_LThd = Simulink.Parameter(47, StorageClass="Volatile", DataType="single")  % DAB Primary Side Sic Max Temp Limit
InMgmt_GridVRMS_LTHD = Simulink.Parameter(210, StorageClass="Volatile", DataType="single")  % DAB Primary Side Sic Max Temp Limit
InMgmt_GridIRMS_UTHD = Simulink.Parameter(50, StorageClass="Volatile", DataType="single")  % DAB Primary Side Sic Max Temp Limit
InMgmtGridI_UTHD = Simulink.Parameter(150, StorageClass="Volatile", DataType="single")  % DAB Primary Side Sic Max Temp Limit