% Simulink data dictionary SWC_InpMgmt_AFE.sldd
% references Shared.sldd

InpMgmt_Grid_V_R_ru2_TC = Simulink.Parameter(440, StorageClass="Volatile", DataType="single")
InpMgmt_Grid_V_R_ru2_TO = Simulink.Parameter(0, StorageClass="Volatile", DataType="boolean")
InpMgmt_Grid_V_Y_ru2_TO = Simulink.Parameter(0, StorageClass="Volatile", DataType="boolean")
InpMgmt_Grid_V_B_ru2_TO = Simulink.Parameter(0, StorageClass="Volatile", DataType="boolean")
InpMgmt_Grid_V_Y_ru2_TC = Simulink.Parameter(440, StorageClass="Volatile", DataType="single")
InpMgmt_Grid_V_B_ru2_TC = Simulink.Parameter(440, StorageClass="Volatile", DataType="single")
InpMgmt_Grid_I_R_ru2_TC = Simulink.Parameter(440, StorageClass="Volatile", DataType="single")
InpMgmt_Grid_I_Y_ru2_TC = Simulink.Parameter(440, StorageClass="Volatile", DataType="single")
InpMgmt_Grid_I_B_ru2_TC = Simulink.Parameter(440, StorageClass="Volatile", DataType="single")
InpMgmt_Grid_I_R_ru2_TO = Simulink.Parameter(0, StorageClass="Volatile", DataType="boolean")
InpMgmt_Grid_I_Y_ru2_TO = Simulink.Parameter(0, StorageClass="Volatile", DataType="boolean")
InpMgmt_Grid_I_B_ru2_TO = Simulink.Parameter(0, StorageClass="Volatile", DataType="boolean")
InpMgmt_DCV_Act_ru_TO = Simulink.Parameter(0, StorageClass="Volatile", DataType="boolean")
InpMgmt_Requested_DCV_Ref_ru_TO = Simulink.Parameter(0, StorageClass="Volatile", DataType="boolean")
DTNA_Shared_ConfigurationCopy = Simulink.ConfigSet(StartTime="0", StopTime="100", Solver="FixedStepDiscrete", ProdHWDeviceType="Texas Instruments->C2000", SystemTargetFile="ert.tlc", HardwareBoard="TI F280025C LaunchPad", TargetLang="C")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
InpMgmt_AFE_IGBTTemp_TO = Simulink.Parameter(0, StorageClass="Volatile", DataType="boolean")
InpMgmt_AFE_GDR_TO = Simulink.Parameter(0, StorageClass="Volatile", DataType="boolean")
InpMgmt_AFE_GDR_TC = Simulink.Parameter(0, StorageClass="Volatile", DataType="single")

Grid_VRYB = Simulink.Bus()  % Adapter data from Core 1 ASIL B transmitted  to Core 0 ASIL C at 5/SwFrq
  Grid_VR: uint16, Min=0, Max=1023
  Grid_VY: uint16, Min=0, Max=1023
  Grid_VB: uint16, Min=0, Max=1023

InpMgmt_DCV_Act_ru_TC = Simulink.Parameter(440, StorageClass="Volatile", DataType="uint16")
InpMgmt_Requested_DCV_Ref_ru_TC = Simulink.Parameter(440, StorageClass="Volatile", DataType="uint16")
InpMgmt_AFE_IGBTTemp_TC = Simulink.Parameter(0, StorageClass="Volatile", DataType="boolean")
Offset_Value = Simulink.Parameter(2048, StorageClass="Volatile", DataType="single")
GRID_VOLT_SNSR_GAIN = Simulink.Parameter(0.009724187, StorageClass="Volatile", DataType="single")
GRID_VOLT_ADC_GAIN = Simulink.Parameter(620.4545455, StorageClass="Volatile", DataType="single")
GRID_CURR_SNSR_GAIN = Simulink.Parameter(0.0466761, StorageClass="Volatile", DataType="single")
GRID_CURR_ADC_GAIN = Simulink.Parameter(620.6061, StorageClass="Volatile", DataType="single")
DC_VOLT_SNSR_GAIN = Simulink.Parameter(0.0033, StorageClass="Volatile", DataType="single")
DC_VOLT_ADC_GAIN = Simulink.Parameter(620.4545, StorageClass="Volatile", DataType="single")