% Simulink data dictionary Shared.sldd

SAMPLE_TIME_200_uSec = Simulink.Parameter(0.0002, StorageClass="Const")
SAMPLE_TIME_1_mSec = Simulink.Parameter(0.001, StorageClass="Const")
DTNA_Shared_Configuration = Simulink.ConfigSet(StartTime="0", StopTime="100", FixedStep="2.5e-6", Solver="FixedStepDiscrete", ProdHWDeviceType="Texas Instruments->C2000", SystemTargetFile="ert.tlc", HardwareBoard="TI F28003x", TargetLang="C")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
DC_DC_Charger_Configuration = Simulink.ConfigSet(StartTime="0", StopTime="Inf", Solver="FixedStepDiscrete", ProdHWDeviceType="Texas Instruments->C2000", SystemTargetFile="ert.tlc", HardwareBoard="TI F28003x", TargetLang="C")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